# Grasshopper definition EJ_001_Probability_killing.gh (Grasshopper 0.9.76)
# Copyright: Ángel Linares García 2014
# plug-ins: Python Interpreter

dmax = Slider(13, range=0..50)
# CODE: import rhinoscriptsyntax as rs
# import random as rd
# 
# circ = []
# probList = []
# 
# for c in Circles:
#     center = rs.CircleCenterPoint(c)
#     dist = rs.Distance(ptO,center)
# 
#     #Giving a dice to every circle and rolling it.
#     r = rd.random()
# 
#     #Translating distances into 0-1 range
#     prob = (dist)/dMax
# 
#     if prob>r:
#         circ.append(c)
#         probList.append(prob)
# 
# circlesCulled = circ
# EJERCICIO_001: En este ejercicio vamos a introducir los números aleatorios como una herramienta para introducir distribuciones azarosas pero controladas en nuestros diseños.
# 
# Prestar atención al uso de la librería rhinoscriptsyntax para calcular algunos valores necesarios para el argoritmo.
# 
# Ejercicio propuesto: investigar que es el seed number y como aplicarlo e nuestra llamada a rd.random()
# 
# Reto: intentar introducir más de un atractor en el algoritmo.
atractor = Point(Point(14.47718729, 14.90609702, 0))
origen = Point(<point referenced from the Rhino model>)
sqgrid = Square(Plane=origen, Size=Slider(1, range=0.1..5), ExtentX=Slider(29, range=1..50), ExtentY=Slider(32, range=1..50))  # -> Cells, Points
circle = CircleCNR(Center=sqgrid.Points, Normal=Vector(0, 0, 1), Radius=Slider(0.4, range=0.1..5))  # -> flatten(Circle)
killing_them_softly = PythonScript(ptO=atractor, Circles=circle, dMax=dmax)  # -> out, circlesCulled, probList; inputs Circles: list
# ---------- killing_them_softly: Python ----------
import rhinoscriptsyntax as rs
import random as rd

circ = []
probList = []

for c in Circles:
    center = rs.CircleCenterPoint(c)
    dist = rs.Distance(ptO,center)
    
    #Giving a dice to every circle and rolling it.
    r = rd.random()
    
    #Translating distances into 0-1 range
    prob = (dist)/dMax
    
    if prob>r:
        circ.append(c)
        probList.append(prob)
        
circlesCulled = circ
# ---------- end killing_them_softly ----------

# ---- group: Representación
bnd = Bounds(Numbers=killing_them_softly.probList)  # disabled
boundary = BoundarySurfaces(Edges=killing_them_softly.circlesCulled)  # disabled
dedomain = DeconstructDomain(Domain=bnd)  # -> Start, End; disabled
gradient = Gradient(
    LowerLimit=dedomain.Start,
    UpperLimit=dedomain.End,
    Parameter=killing_them_softly.probList,
    stops=[0: RGB(234, 38, 0), 0.25: RGB(234, 126, 0), 0.5: RGB(254, 244, 84), 0.75: RGB(173, 203, 249), 1: RGB(75, 107, 169)])  # disabled
preview = CustomPreview(Geometry=boundary, Shader=gradient)  # disabled
