# Grasshopper definition ACC_EJ_000.gh (Grasshopper 0.9.76)
# Copyright: Ángel Linares García 2014
# plug-ins: Python Interpreter

# EJERCICIO_000: En este ejercicio vamos a poner en práctica algunos conocimientos adquiridos como son el uso de listas y los bucles "For".
# 
# Prestar especial atención en el uso del módulo "ghpythonlib.components" utilizado para importar componentes de GH como si de funciones nativas de Python se trataran.
# 
# Reto: pasar ecuación a esféricas e inventar una conponente z al estilo de x e y. Puedes usar delaunay sobre la malla de puntos para obtener una malla rapida que te permita visualizar la nube de puntos.
pt = ConstructPoint(XCoordinate=0, YCoordinate=0, ZCoordinate=0)

pt_2 = Point(pt)

betha = Slider(137.508, range=0..360)
# CODE: import rhinoscriptsyntax as rs
# import math as m
# import ghpythonlib.components as gh
# 
# auxPts = []
# for i in range(It):
#     angTheta = i*Alpha
#     angFi = i*Betha
#     x = C*m.sqrt(angTheta)*m.sqrt(angFi)*m.sin(angTheta)*m.cos(angFi)
#     y = C*m.sqrt(angTheta)*m.sqrt(angFi)*m.sin(angTheta)*m.sin(angFi)
#     z = C*m.sqrt(angTheta)*m.sqrt(angFi)*m.cos(angTheta)
#     pt = rs.AddPoint(x,y,z)
#     auxPts.append(pt)
# 
# Pts = auxPts
python = PythonScript(
    ptB=pt_2,
    C=Slider(0.24, range=0.01..10),
    Alpha=Slider(137.508, range=0..360),
    Betha=betha,
    It=Slider(286, range=0..1500),
    rad=Slider(5, range=0..5))  # -> Pts, dela; inputs It: Int32; disabled
# ---------- python: Python ----------
import rhinoscriptsyntax as rs
import math as m
import ghpythonlib.components as gh

auxPts = []
for i in range(It):
    angTheta = i*Alpha
    angFi = i*Betha
    x = C*m.sqrt(angTheta)*m.sqrt(angFi)*m.sin(angTheta)*m.cos(angFi)
    y = C*m.sqrt(angTheta)*m.sqrt(angFi)*m.sin(angTheta)*m.sin(angFi)
    z = C*m.sqrt(angTheta)*m.sqrt(angFi)*m.cos(angTheta)
    pt = rs.AddPoint(x,y,z)
    auxPts.append(pt)

Pts = auxPts 
#dela = gh.Delaunay(Pts)
# ---------- end python ----------
panel = Panel(python.Pts)
del = DelaunayMesh(Points=python.Pts, Plane=PlaneXY(0, 0, 0))
