# Grasshopper definition CRJ_EJ_000_Fermat'sspiral.gh (Grasshopper 0.9.76)
# Copyright: Ángel Linares García 2014
# plug-ins: Python Interpreter

# ----
# EJERCICIO_000: En este ejercicio vamos a poner en práctica algunos conocimientos adquiridos como son el uso de listas y los bucles "For".
# 
# Prestar especial atención en el uso del módulo "ghpythonlib.components" utilizado para importar componentes de GH como si de funciones nativas de Python se trataran.
# 
# Reto: pasar ecuación a esféricas e inventar una conponente z al estilo de x e y. Puedes usar delaunay sobre la malla de puntos para obtener una malla rapida que te permita visualizar la nube de puntos.
pt = Point(<point referenced from the Rhino model>)
# VARIABLES ESPIRAL DE FERMAT
# 
# ptB= Punto base
# C= coeficiente de escala
# Alpha= ángulo modifica la espiral (Alpha=n*137.508)
# It= numero de iteraciones
# rad= radio del algoritmo de voronoid
number_slider = Slider(2.31, range=0..5)

# ----
# CODE: import rhinoscriptsyntax as rs
# import math as m
# import ghpythonlib.components as gh
# 
# auxPts = []
# 
# for i in range(It):
#     angTheta = i*Alpha
#     pt = rs.Polar(ptB,angTheta,C*m.sqrt(angTheta))
#     auxPts.append(pt)
# 
# Pts = auxPts
# vor = gh.Voronoi(Pts,rad)
python = PythonScript(
    ptB=pt,
    C=Slider(0.16, range=0.01..10),
    Alpha=Slider(137.508, range=0..360),
    It=Slider(460, range=0..1500),
    rad=number_slider)  # -> Pts, vor; inputs It: Int32
# ---------- python: Python ----------
#importar librerias
import rhinoscriptsyntax as rs
import math as m
import ghpythonlib.components as gh

#lista vacia puntos
listPts = []
#radio esfera
r = C*m.sqrt((It-1)*Alpha) 

#bucle espiral-esfera
for i in range(It):
    angTheta = i*Alpha
    rh = C*m.sqrt(angTheta)
    pt = rs.Polar(ptB,angTheta,rh)
    #lista puntos planos
    listPts.append(pt)
    
    #rv = sqrt(r^2-rh^2) pitágoras
    rv = m.sqrt(m.pow(r,2)-m.pow(rh,2))
    #sustituir la Z de cada punto por su rv
    listPts[i].Z=rv
    print listPts

Pts = listPts 
#vor = gh.Voronoi(Pts,rad)
# ---------- end python ----------
con = DelaunayEdges(Points=python.Pts, Plane=PlaneXY(0, 0, 0))  # -> Connectivity, Edges
# PASOS DEL CÓDIGO
# 
# 1. Importar libreria rhino
# 2. Crear una lista vacia
# 3. Bucle donde controlamos el numero de iteraciones (It) que lo controlamos con un slider
# 4. Calcula el ángulo de cada uno de esos puntos (es una ecuacion enunciada por fermat)
# 5. Crea un punto, una variable que se llama pt, un punto por coordenadas polares. Le metemos el pto base como origen, el ángulo Theta que hemos calculado, y el radio mediante la ecuación de fermat
# 6. Metemos ese punto nuevo en la lista
del = DelaunayMesh(Points=python.Pts, Plane=PlaneXY(0, 0, 0))
