# Grasshopper definition EVV_EJ_000.gh (Grasshopper 0.9.76)
# Copyright: Ángel Linares García 2014
# plug-ins: Python Interpreter

number_slider = Slider(5, range=0..5)
# EJERCICIO_000: En este ejercicio vamos a poner en práctica algunos conocimientos adquiridos como son el uso de listas y los bucles "For".
# 
# Prestar especial atención en el uso del módulo "ghpythonlib.components" utilizado para importar componentes de GH como si de funciones nativas de Python se trataran.
# 
# Reto: pasar ecuación a esféricas e inventar una conponente z al estilo de x e y. Puedes usar delaunay sobre la malla de puntos para obtener una malla rapida que te permita visualizar la nube de puntos.
pt = Point(<point referenced from the Rhino model>)
number_slider_2 = Slider(0.24, range=0.01..10)
number_slider_3 = Slider(137.508, range=0..360)
number_slider_4 = Slider(248, range=0..1500)

# ----
# CODE: import rhinoscriptsyntax as rs
# import math as m
# import ghpythonlib.components as gh
# 
# auxPts = []
# 
# for i in range(It):
#     angTheta = i*Alpha
#     pt = rs.Polar(ptB,angTheta,C*m.sqrt(angTheta))
#     auxPts.append(pt)
# 
# Pts = auxPts
# vor = gh.Voronoi(Pts,rad)
python = PythonScript(ptB=pt, C=number_slider_2, Alpha=number_slider_3, It=number_slider_4, rad=number_slider, x=Slider(1.7, range=1..5))  # -> Pts, vor; inputs It: Int32
# ---------- python: Python ----------
import rhinoscriptsyntax as rs
import math as m
import ghpythonlib.components as gh

auxPts = []

R=x*C*m.sqrt(It*Alpha)

for i in range(It):
    angTheta = i*Alpha
    #pt = rs.Polar(ptB,angTheta,C*m.sqrt(angTheta))
    xp=C*m.sqrt(angTheta)*m.cos(angTheta)
    yp=C*m.sqrt(angTheta)*m.sin(angTheta)
    zp=m.sqrt(R**2-xp**2-yp**2)-(x-1)*C*m.sqrt(It*Alpha)
    pt = rs.AddPoint(xp,yp,zp)
    auxPts.append(pt)
    
Pts = auxPts 
vor = gh.Voronoi(Pts,rad)
# ---------- end python ----------
python_2 = PythonScript(ptB=pt, C=number_slider_2, Alpha=number_slider_3, It=number_slider_4, rad=number_slider)  # -> Pts, vor; inputs It: Int32; disabled
# ---------- python_2: Python ----------
import rhinoscriptsyntax as rs
import math as m
import ghpythonlib.components as gh

auxPts = []

for i in range(It):
    angTheta = i*Alpha
    pt = rs.Polar(ptB,angTheta,C*m.sqrt(angTheta))
    auxPts.append(pt)
    
Pts = auxPts 
vor = gh.Voronoi(Pts,rad)
# ---------- end python_2 ----------
del = DelaunayMesh(Points=python.Pts, Plane=PlaneXY(0, 0, 0))
con = DelaunayEdges(Points=python.Pts, Plane=PlaneXY(0, 0, 0))  # -> Connectivity, Edges
