# Grasshopper definition JBG_EJ_000_nada_nuevo.gh (Grasshopper 0.9.76)
# Copyright: Ángel Linares García 2014
# plug-ins: Python Interpreter

pt = Point(<point referenced from the Rhino model>)

python = PythonScript(
    ptB=pt,
    C=Slider(0.24, range=0.01..10),
    Alpha=Slider(137.508, range=0..360),
    It=Slider(185, range=0..1500),
    rad=Slider(5, range=0..5))  # -> Pts, vor; inputs It: Int32
# ---------- python: Python ----------
import rhinoscriptsyntax as rs
import math as m
import ghpythonlib.components as gh

auxPts = []

for i in range(It):
    angTheta = i*Alpha
    pt = rs.Polar(ptB,angTheta,C*m.sqrt(angTheta))
    auxPts.append(pt)
    
Pts = auxPts 
vor = gh.Voronoi(Pts,rad)
# ---------- end python ----------
