# Grasshopper definition PD_fermat3D.gh (Grasshopper 0.9.76)
# plug-ins: Python Interpreter

max_angle = Slider(45, range=0..90)
pt = Point(Point(-2.990144826, 2.574950008, 0))
python = PythonScript(ptB=pt, C=Slider(1, range=1..10), Alpha=Slider(137.508, range=0..360), It=Slider(150, range=0..200), sphere=max_angle)  # -> out, flatten(a), b; inputs It: Int32
# ---------- python: Python ----------
import rhinoscriptsyntax as rs
import Grasshopper as gs
import Rhino.Geometry as rg
import math as m 

auxPt = []
azilist = []


for i in range(It):
    angTheta = i*Alpha
    pt= rs.Polar(ptB, angTheta, C*m.sqrt(angTheta))
    
    #-------Hasta aquí Fermat ------
    
    #Sacamos angulos de giro ''azi'' para cada punto entre 0-sphere siendo sphere <=90
    azi =(-m.sqrt(angTheta/(It*Alpha)))*sphere
    
    #Sacamos la normal ''axis''a cada punto (multiplicando el vector del punto al origen por el z)
    v1 = rs.VectorCreate(ptB,pt)
    vz = rs.VectorCreate((0,0,0),(0,0,1))
    
    axis = rs.VectorCrossProduct(v1,vz)
    
    #Creamos la transformación giro azi grados alrededor del eje axis en el punto origen
    
    transform = rs.XformRotation2(azi,axis,ptB)
    
    pts = rs.PointTransform(pt,transform)
    
    #recogemos todos los puntos en una lista
    auxPt.append(pts)
    

    
a= auxPt

b = auxPt [1:]
# ---------- end python ----------
pt_2 = Point(python.b)
