# Grasshopper definition EJ_000.gh (Grasshopper 0.9.76)
# Copyright: Ángel Linares García 2014
# plug-ins: Python Interpreter

# ----
# EJERCICIO_000: En este ejercicio vamos a poner en práctica algunos conocimientos adquiridos como son el uso de listas y los bucles "For".
# 
# Prestar especial atención en el uso del módulo "ghpythonlib.components" utilizado para importar componentes de GH como si de funciones nativas de Python se trataran.
# 
# Reto: pasar ecuación a esféricas e inventar una conponente z al estilo de x e y. Puedes usar delaunay sobre la malla de puntos para obtener una malla rapida que te permita visualizar la nube de puntos.
pt = Point(<point referenced from the Rhino model>)

# ----
# CODE: import rhinoscriptsyntax as rs
# import math as m
# import ghpythonlib.components as gh
# 
# auxPts = []
# 
# for i in range(It):
#     angTheta = i*Alpha
#     pt = rs.Polar(ptB,angTheta,C*m.sqrt(angTheta))
#     auxPts.append(pt)
# 
# Pts = auxPts
# vor = gh.Voronoi(Pts,rad)
python = PythonScript(
    ptB=pt,
    C=Slider(0.24, range=0.01..10),
    Alpha=Slider(137.508, range=0..360),
    It=Slider(248, range=0..1500),
    rad=Slider(5, range=0..5))  # -> Pts, vor; inputs It: Int32
# ---------- python: Python ----------
import rhinoscriptsyntax as rs
import math as m
import ghpythonlib.components as gh

auxPts = []

for i in range(It):
    angTheta = i*Alpha
    pt = rs.Polar(ptB,angTheta,C*m.sqrt(angTheta))
    auxPts.append(pt)
    
Pts = auxPts 
vor = gh.Voronoi(Pts,rad)
# ---------- end python ----------
