# Grasshopper definition Ej_002_Random_walker.gh (Grasshopper 0.9.76)
# Copyright: Ángel Linares García 2014
# plug-ins: Python Interpreter

# EJERCICIO_002: En este ejercicio introducimos varias novedades en nuestros conocimientos de control de flujo, por un lado, poder parar un bucle en cualquier punto de su proceso y por otro una nueva modalidad de bucle llamada "while" que engloba un bucle y una comprobación booleana en cada loop.
# 
# Ejercicio propuesto: ejercicio por grupos.
pt = Point(<point referenced from the Rhino model>)
iterations = Slider(500, range=0..500)
crv = Curve(<curve referenced from the Rhino model>)
seed = Slider(228, range=1..500)
# CODE: import Rhino.Geometry as rg
# import random as r
# 
# ptList = []
# ptNew = pt0
# r.seed(s)
# 
# for i in range(it):
# 
#     #Avoiding error produced by pt0 being outside the curve
#     if rg.BrepTrim.Contains(crv,pt0) == rg.PointContainment.Outside: break
# 
#     if i == 0:
# 
#         lastPt = pt0
#     else:
#         lastPt = ptList[-1]
# 
#     newv3d = rg.Vector3d(r.randint(-1,1),r.randint(-1,1),0)
#     ptNew = lastPt + newv3d
# 
#     while rg.BrepTrim.Contains(crv,ptNew) == rg.PointContainment.Outside:
#         newv3d = rg.Vector3d(r.randint(-1,1),r.randint(-1,1),0)
#         ptNew = lastPt + newv3d
# 
#     ptList.append(ptNew)
# 
# a = ptList
rw = PythonScript(pt0=pt, it=iterations, crv=crv, s=seed)  # -> out, a; inputs pt0: Point3d, it: Int32, crv: Curve, s: Int32
# ---------- rw: Python ----------
import Rhino.Geometry as rg
import random as r

ptList = []
ptNew = pt0
r.seed(s)

for i in range(it):
    
    #Avoiding error produced by pt0 being outside the curve
    if rg.BrepTrim.Contains(crv,pt0) == rg.PointContainment.Outside: break
    
    if i == 0:
        
        lastPt = pt0
    else:
        lastPt = ptList[-1]    
        
    newv3d = rg.Vector3d(r.randint(-1,1),r.randint(-1,1),0)
    ptNew = lastPt + newv3d       
    
    while rg.BrepTrim.Contains(crv,ptNew) == rg.PointContainment.Outside:
        newv3d = rg.Vector3d(r.randint(-1,1),r.randint(-1,1),0)
        ptNew = lastPt + newv3d
  
    ptList.append(ptNew)
    
a = ptList
# ---------- end rw ----------
circle = CircleCNR(Center=rw.a, Normal=Vector(0, 0, 1), Radius=0.1)
pline = PolyLine(Vertices=rw.a, Closed=False)
