# Grasshopper definition EVV_Ej_002_Random_walker_mod.gh (Grasshopper 0.9.76)
# plug-ins: Python Interpreter

n = Slider(5, range=3..10)
s = Slider(30, range=1..100)
it = Slider(10, range=2..500)
r = Slider(0.5, range=0..1)
pt = Point(<point referenced from the Rhino model>)
python = PythonScript(Pto=pt, It=it, s=s, r=r, n=n)  # -> out, lsimetr, listPolig; inputs Pto: Point3d, It: Int32, s: Int32, n: Int32
# ---------- python: Python ----------
# =====================================
# Mini-project # 002
# Random Walker
# v.2.0(12/11/2015)
# Enrique Vazquez
# =========================================

# Traza una ruta aleatoria partiendo de un punto


# Carga de librerias --------------------
import math as m
import random as rd
import Rhino.Geometry as rg
#import ghpythonlib.components as gh
import rhinoscriptsyntax as rs


# Variables iniciales --------------------
#ruta=[] # lineas de la ruta
listCt=[] # lista de puntos de la ruta
center=Pto # variable para el bucle
listCt.append(center) # añade a la lista el punto inicial
listPolig=[]


# Semilla --------------------------------
rd.seed(s)


# Cuerpo de la rutina.
# Generación de los puntos y lineas de la ruta
# ------------------------------------------
for i in range(0,It):
    circle=rg.Circle(center,r)
    curve=rg.Circle.ToNurbsCurve(circle)
    ptos=rs.DivideCurve(curve,n)
    ptos.append(ptos[0])
    polig=rs.AddPolyline(ptos)
    poligCrv=rs.coercecurve(polig)
    listPolig.append(poligCrv)
    lines=rs.ExplodeCurves (polig, True)
    nlin=rd.randint(0,n-1)
    lsimetr=lines[nlin]
    
    
    
    #m=2*rd.randint(-1,1)
    #n=2*rd.randint(-1,1)
    #movmt=rg.Vector3d(m,n,0) # vector desplazamiento
    # el nuevo punto se calcula mediante un desplzamiento a
    # del punto anterior
    #newPt=newPt+movmt
    #listPt.append(newPt) #se añade el nuevo punto a la lista
    #ruta.append(rg.Line(listPt[i-1],listPt[i])) #se alñade la nueva ruta a la lista



#ruta(rg.BezierCurve(controlPoints: listPt)
# ---------- end python ----------
python_2 = PythonScript(Pto=pt, It=it, s=s, r=r, n=n)  # -> out, pt0, listPolig; inputs Pto: Point3d, It: Int32, s: Int32, n: Int32
# ---------- python_2: Python ----------
# =====================================
# Mini-project # 002
# Random Walker
# v.2.0(12/11/2015)
# Enrique Vazquez
# =========================================

# Traza una ruta aleatoria partiendo de un punto


# Carga de librerias --------------------
import math as m
import random as rd
import Rhino.Geometry as rg
import ghpythonlib.components as gh
import rhinoscriptsyntax as rs


# Variables iniciales --------------------
#ruta=[] # lineas de la ruta
listCt=[] # lista de puntos de la ruta
center=Pto # variable para el bucle
listCt.append(center) # añade a la lista el punto inicial
listPolig=[]


# Semilla --------------------------------
rd.seed(s)


# Cuerpo de la rutina.
# Generación de los puntos y lineas de la ruta
# ------------------------------------------
circle=rg.Circle(center,r)
curve=rg.Circle.ToNurbsCurve(circle)
ptos=rs.DivideCurve(curve,n)
ptos.append(ptos[0])
polig=rs.AddPolyline(ptos)
poligCrv=rs.coercecurve(polig)
listPolig.append(poligCrv)
lines=rs.ExplodeCurves (polig, True)

for i in range(0,It):
    poligon=listPolig[0]
    nlin=rd.randint(0,n-1)
    mirraxis=lines[nlin]
    pt0=rs.CurveEndPoint(mirraxis)
    pt1=rs.CurveStartPoint(mirraxis)
    vect=rs.VectorUnitize(rg.Vector3d(pt1.X-pt0.X,pt1.Y-pt0.Y,0))
    normal_vec = rs.coerce3dvector([0,0,1])
    vect2 = rg.Vector3d.CrossProduct(vect, normal_vec)
    print vect2
    #mirror_matrix = rg.Transform.Mirror(pt0, vect)
    #newpolig = poligon.Transform(mirror_matrix)
    #newpolig = poligon
    #a = crv
    
    #m=2*rd.randint(-1,1)
    #n=2*rd.randint(-1,1)
    #movmt=rg.Vector3d(m,n,0) # vector desplazamiento
    # el nuevo punto se calcula mediante un desplzamiento a
    # del punto anterior
    #newPt=newPt+movmt
    #listPt.append(newPt) #se añade el nuevo punto a la lista
    #ruta.append(rg.Line(listPt[i-1],listPt[i])) #se alñade la nueva ruta a la lista



#ruta(rg.BezierCurve(controlPoints: listPt)
# ---------- end python_2 ----------
crv = Curve(python_2.listPolig)
