# Grasshopper definition jpl_random_walker_02.gh (Grasshopper 0.9.76)
# plug-ins: Python Interpreter

iterator = Slider(275, range=0..360)
python = PythonScript(It=iterator)  # -> out, a; inputs It: Int32
# ---------- python: Python ----------
import Rhino.Geometry as rg
import random as r

ptlist = []
x = 0
y = 0
z = 0
pt0 = rg.Point3d(x,y,z)
ptlist.append(pt0)

for i in range(It):
    x1 = x + r.randint(-1,1)
    y1 = y + r.randint(-1,1)
    #z1 = z + r.randint(-2,3)
    z1 = 0
    pt = rg.Point3d(x1,y1,z1)
    #print pt
    ptlist.append(pt)
    x = x1
    y = y1
    #z = z1

a = ptlist
#print ptlist
# ---------- end python ----------
pline = PolyLine(Vertices=python.a, Closed=False)
