# Grasshopper definition ACH_EJ01.gh (Grasshopper 0.9.76)
# plug-ins: Python Interpreter

pt = Point(<point referenced from the Rhino model>)
python = PythonScript(Pt0=pt, It=Slider(100, range=0..100), s=Slider(100, range=0..100))  # -> out, PtList, Linea; inputs Pt0: Point3d, It: Int32
# ---------- python: Python ----------
import rhinoscriptsyntax as rs
import random as rd
import Rhino.Geometry as rg

Ptnew = Pt0
PtList = []
rd.seed(s)

for i in range(It):
    
    SumaX = rd.randint(-1,1)
    
    SumaY = rd.randint(-1,1)
    
    Ptnew = rg.Point3d(Ptnew.X + SumaX, Ptnew.Y + SumaY,0)
    
    PtList.append(Ptnew)
    
    Linea = rg.PolylineCurve(PtList)
# ---------- end python ----------
