# Grasshopper definition jpl_random_walker_01.gh (Grasshopper 0.9.76)
# plug-ins: Python Interpreter

iterator = Slider(1110, range=0..1200)
seed = Slider(14, range=0..24)
pt = Point(Point(0, 0, 0))
python = PythonScript(pt0=pt, it=iterator, s=seed)  # -> out, a; inputs pt0: Point3d, it: Int32, s: Int32
# ---------- python: Python ----------
import Rhino.Geometry as rg
import random as r

ptList = []
ptNew = pt0
ptList.append(ptNew)
print ptList
ptPrueba = rg.Point3d(1.0,1.0,0)
print ptPrueba
r.seed(s)

for i in range(it):
    print i
    v3d = rg.Vector3d(r.randint(-1,1),r.randint(-1,1),0)
    ptNew = ptNew + v3d
    
    ptList.append(ptNew)
    
a = ptList
# ---------- end python ----------
pline = PolyLine(Vertices=python.a, Closed=False)
