# Grasshopper definition ALG_EJ_002_Polygon_creation.gh (Grasshopper 0.9.76)
# Copyright: Ángel Linares García 2014
# plug-ins: Python Interpreter

pt = Point(<point referenced from the Rhino model>)
python = PythonScript(pt=pt, n=Slider(5, range=1..25), r=Slider(1.38, range=0.01..15))  # -> out, pol; inputs n: Int32
# ---------- python: Python ----------
import Rhino.Geometry as rg
import rhinoscriptsyntax as rs

pts = []

# Creates a loop to build points with polar coordinates
# at 2Pi/n increments.

for i in range(n):
    pts.append(rs.Polar(pt,i*(360.0/n),r))

pts.append(pts[0]) # Appends the first point again to close the curve

pol = rg.PolylineCurve(pts) 

# rg.PolylineCurve != rg.Polyline
# Polyline = just an ordered list of points3d
# PolylineCurve = and actual Polyline curve
# ---------- end python ----------
