# Grasshopper definition CRJ_Ej_002_Random_Walker_Modified.gh (Grasshopper 0.9.76)
# plug-ins: Python Interpreter

n = Slider(5, range=3..20)
s = Slider(12, range=0..100)
r = Slider(15.534, range=0..100)
it = Slider(47, range=2..500)
pt = Point(<point referenced from the Rhino model>)
python = PythonScript(pt0=pt, r=r, n=n, It=it, s=s)  # -> out, curve, points, lines; inputs pt0: Point3d, n: Int32, It: Int32
# ---------- python: Python ----------
#CRJ_RandomWalker_Modified

#librerias
import Rhino.Geometry as rg
import math as m
import random as rd
import rhinoscriptsyntax as rs

#semilla
rd.seed(s)

#variable centro poligono
centro=pt0

#bucle
for i in range (It):
    #dibuja un círculo con centro pt0 y radio r
    circle = rg.Circle(centro,r)
    #convertir circulo en curva
    curve = circle.ToNurbsCurve()
    #divide la curva en n partes
    points = rs.DivideCurve(curve,n,False,True)
    #añadir a la lista su primer punto
    points.append(points[0])
    #dibuja lineas
    lines = rs.AddPolyline(points)
# ---------- end python ----------
