# Grasshopper definition ACC_random_interpolate.gh (Grasshopper 0.9.76)
# plug-ins: Python Interpreter

y = Slider(0, range=0..100)
x = Slider(0, range=0..100)
panel = Panel("punto de inicio")
seed = Slider(6, range=0..10)
iteracion = Slider(12, range=0..5000)
grado = Slider(5, range=0..10)
randomwalker1 = PythonScript(x=x, y=y, s=seed, It=iteracion, g=grado)  # -> out, curva; inputs s: Int32, It: Int32, g: Int32
# ---------- randomwalker1: Python ----------
import random as rd
import Rhino.Geometry as rg

#Creamos una lista de puntos vacía en la que metemos los puntos que vayamos creando
#Partimos de un punto que elegimos con las coordinadas x e y

ptNew = rg.Point3d(x,y,0)
ptList = []
ptList.append(ptNew)
rd.seed(s)

#bucle
for i in range(It):
    #Se crean coordenadas X e Y que se van incrementando
    coorX = ptNew.X + rd.randint(-1,1)
    coorY = ptNew.Y + rd.randint(-1,1)
    #Se crea un punto en la nueva coordenada
    ptNew = rg.Point3d(coorX, coorY, 0)
    #Se van adjuntando los puntos a la lista
    ptList.append(ptNew)
    
#curva = rg.Curve.CreateControlPointCurve(ptList)
curva = rg.Curve.CreateInterpolatedCurve(ptList,g)
#Probamos con bezier
print curva
#crv = rg.BezierCurve.CreateCubicBeziers(curva,t1,t2)
# ---------- end randomwalker1 ----------
panel_2 = Panel(randomwalker1.curva)
