# Grasshopper definition jpl_panelado_superficie_v0.gh (Grasshopper 0.9.76)
# plug-ins: Python Interpreter

num_divisiones_u = Slider(6, range=0..24)
num_divisiones_v = Slider(7, range=0..24)
python = PythonScript(uDiv=num_divisiones_u, vDiv=num_divisiones_v)  # -> out, ptList, panel; inputs srf: Surface, uDiv: Int32, vDiv: Int32
# ---------- python: Python ----------
import Rhino.Geometry as rg

for i in range(uDiv+1):
    for j in range(vDiv+1):
        
        print "puntos " + str(i) + "." + str(j)
# ---------- end python ----------
