# Grasshopper definition jpl_panelado_superficie_v01_triangulos.gh (Grasshopper 0.9.76)
# plug-ins: Python Interpreter

num_divisiones_u = Slider(7, range=0..24)
num_divisiones_v = Slider(7, range=0..24)
# Reparamtetriza la superficie u, v va de cero a 1
srf = Surface(reparameterize(<surface referenced from the Rhino model>))
python = PythonScript(srf=srf, uDiv=num_divisiones_u, vDiv=num_divisiones_v)  # -> out, ptList, panel; inputs srf: Surface, uDiv: Int32, vDiv: Int32
# ---------- python: Python ----------
#panelado triangulos
import Rhino.Geometry as rg

ptList = []
polList = []

for i in range(uDiv+1):
    ptListTemp = []
    for j in range(vDiv+1):
        
        #print "puntos " + str(i) + "." + str(j)
        #atencion superficie reparametrizada en gh
        ptTemp = srf.Evaluate(i/uDiv,j/vDiv,2)[1]
        ptListTemp.append(ptTemp)
        
    ptList.append(ptListTemp)
    #print ptList

for i in range(uDiv):
    for j in range(vDiv):
        pt0 = ptList[i][j]
        pt1 = ptList[i+1][j]
        pt2 = ptList[i+1] [j+1]
        pt3 = ptList[i][j+1]
        
        polList.append(rg.Polyline([pt0,pt1,pt3,pt0]))
        polList.append(rg.Polyline([pt1,pt2,pt3,pt1]))
        
panel = polList
# ---------- end python ----------
panel = Panel(python.panel)
fpatch = FragmentPatch(Boundary=python.panel)
item = ListItem(List=fpatch, Index=Slider(156, range=0..240), Wrap=True)
