# Grasshopper definition jpl_random_walker_02_circulos_01.gh (Grasshopper 0.9.76)
# plug-ins: Python Interpreter

iterator = Slider(275, range=0..360)
python = PythonScript(It=iterator)  # -> out, a, radios; inputs It: Int32
# ---------- python: Python ----------
import Rhino.Geometry as rg
import random as r

ptlist = []
x = 0
y = 0
z = 0
rad = 0
radlist = [0]
pt0 = rg.Point3d(x,y,z)
ptlist.append(pt0)

for i in range(It):
    x1 = x + r.randint(-1,1)
    y1 = y + r.randint(-1,1)
    pt = rg.Point3d(x1,y1,z)
    #print pt
    ptlist.append(pt)
    rad1 = r.choice([1,1.1,1.2,1.3,2])
    radlist.append(rad1)
    x = x1
    y = y1
    #z = z1

a = ptlist
radios = radlist
#print ptlist
# ---------- end python ----------
pline = PolyLine(Vertices=python.a, Closed=False)
cir = Circle(Plane=python.a, Radius=python.radios)
