# Grasshopper definition jpl_random_walker_02_circulos_02.gh (Grasshopper 0.9.76)
# plug-ins: Python Interpreter

iterator = Slider(275, range=0..360)
radio_circulos = Slider(0.544, range=0..2)
python = PythonScript(It=iterator, rad=radio_circulos)  # -> out, a, radios; inputs It: Int32
# ---------- python: Python ----------
import Rhino.Geometry as rg
import random as r

ptlist = []
x = 0
y = 0
z = 0
radlist = [0]
pt0 = rg.Point3d(x,y,z)
ptlist.append(pt0)

for i in range(It):
    x1 = x + r.randint(-1,1)
    y1 = y + r.randint(-1,1)
    pt = rg.Point3d(x1,y1,z)
    
    #print pt
    ptlist.append(pt)
    #rad1 = r.choice([0.6,0.8,1,1.2,1.4])
    #radlist.append(rad1)
    if x == x1 and y == y1:
        rad2 = 0
    elif x > x1:
        if y > y1:
            rad2 = 1.8
        else:
            rad2 = 0.3
    else:
        if y > y1:
            rad2 = 0.1
        else:
            rad2 = 1.6
    radlist.append(rad2)
    x = x1
    y = y1
    #z = z1

a = ptlist
radios = radlist
#print ptlist
# ---------- end python ----------
bnd = Bounds(Numbers=python.radios)
dedomain = DeconstructDomain(Domain=bnd)  # -> Start, End
gradient = Gradient(
    LowerLimit=dedomain.Start,
    UpperLimit=dedomain.End,
    Parameter=python.radios,
    stops=[0: RGB(133, 193, 247), 0: RGB(167, 69, 29), 0: RGB(96, 215, 140), 0: RGB(57, 242, 7), 0: RGB(74, 93, 251), 0: RGB(219, 80, 35), 0: RGB(138, 94, 169), 0: RGB(236, 194, 247), 0: RGB(43, 247, 157), 0.141: RGB(250, 189, 97), 0.588: RGB(255, 130, 160), 0.931: RGB(220, 0, 40)])
pline = PolyLine(Vertices=python.a, Closed=False)
cir = Circle(Plane=python.a, Radius=python.radios)
boundary = BoundarySurfaces(Edges=cir)
preview = CustomPreview(Geometry=boundary, Shader=gradient)
cmyk = ColourCMYK(Cyan=0, Magenta=0, Yellow=0, Key=0)
