# Grasshopper definition ACH_002.gh (Grasshopper 0.9.76)
# plug-ins: Python Interpreter

pt = Point(<point referenced from the Rhino model>)
python = PythonScript(
    Pt0=pt,
    It=Slider(100, range=0..100),
    S=Slider(34, range=0..100),
    Amin=Slider(0, range=0..360),
    Amax=Slider(180, range=0..360),
    Rmin=Slider(0, range=0..360),
    Rmax=Slider(101, range=0..360))  # -> out, PtList, LineasList, Medios, Circulos; inputs Pt0: Point3d, It: Int32
# ---------- python: Python ----------
import rhinoscriptsyntax as rs
import random as rd
import Rhino.Geometry as rg

Ptnew = Pt0
PtList = [Pt0]
rd.seed(S)
#DistList = []
LineasList = []
Medios = []
Circulos = []
for i in range(It):
    
    Angle = rd.randint(Amin,Amax)
    R = rd.randint(Rmin,Rmax)
    
    Ptnew = rs.Polar(Ptnew, Angle, R)
    
    PtList.append(Ptnew)
    
    dist = rs.Distance(Ptnew, PtList[-2])/2
    print dist
    if dist == 0:
        dist = 0.01
    else:
        dist = dist       
    Lineas=rs.AddLine(Ptnew,PtList[-2])
    
    LineasList.append(Lineas)
    
    PtMedio = rs.CurveMidPoint(Lineas)
    Medios.append(PtMedio)
    
    Circle = rs.AddCircle(PtMedio,dist)
    Circulos.append(Circle)
# ---------- end python ----------
crv = Curve(python.Circulos)
