# Grasshopper definition ACH_003.gh (Grasshopper 0.9.76)
# Copyright: Ángel Linares García 2014
# plug-ins: Python Interpreter

srf = Surface(reparameterize(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))
srf_2 = Surface(reparameterize(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))
number_slider = Slider(5, range=1..25)
number_slider_2 = Slider(10, range=1..25)
python = PythonScript(srf=srf, uDiv=Slider(10, range=1..25), vDiv=Slider(10, range=1..25))  # -> out, ptList, panel; inputs srf: Surface, uDiv: Int32, vDiv: Int32
# ---------- python: Python ----------
import Rhino.Geometry as rg

ptList = []
polList = []

for i in range (uDiv+1):
    ptListTemp = []
    for j in range(vDiv+1):
        
        ptTemp = srf.Evaluate(i/uDiv,j/vDiv,2)[1]
        ptListTemp.append(ptTemp)
        #print ptTemp
        #print "Punto " + str(i) + "_" + str(j) 
    ptList.append(ptListTemp)     
    
for i in range (uDiv):
    for j in range (vDiv):
        pt0 = ptList[i][j]
        pt1 = ptList[i+1][j]
        pt2 = ptList[i+1][j+1]
        pt3 = ptList[i][j+1]
        
        polList.append(rg.Polyline([pt0,pt1,pt2,pt3,pt0]))
        
    panel = polList
# ---------- end python ----------
dividesrf = PythonScript(srf=srf_2, uDiv=number_slider, vDiv=number_slider_2)  # -> out, ptList, pl; inputs srf: Surface, uDiv: Int32, vDiv: Int32
# ---------- dividesrf: Python ----------
import Rhino.Geometry as rg
from Grasshopper import DataTree as Tree
from Grasshopper.Kernel.Data import GH_Path as Path

ptList = []
ptTree = Tree[object]()
pl = []

for i in range(uDiv+1):
    ptListTemp = []
    for j in range(vDiv+1):
        
        tempPt = srf.Evaluate(i/uDiv,j/vDiv,2)[1]
        ptTree.Add(tempPt,Path(i))
        ptListTemp.append(tempPt)
    ptList.append(ptListTemp)       

for i in range(uDiv):
    for j in range(vDiv):
        
        pt1 = ptList[i][j]
        pt2 = ptList[i+1][j]
        pt3 = ptList[i][j+1]
        pt4 = ptList[i+1][j+1]
        
        pl.append(rg.Polyline([pt1,pt2,pt4,pt3,pt1]))
# ---------- end dividesrf ----------
# CODE Divide Srf: import Rhino.Geometry as rg
# from Grasshopper import DataTree as Tree
# from Grasshopper.Kernel.Data import GH_Path as Path
# 
# ptList = []
# ptTree = Tree[object]()
# pl = []
# 
# for i in range(uDiv+1):
#     ptListTemp = []
#     for j in range(vDiv+1):
# 
#         tempPt = srf.Evaluate(i/uDiv,j/vDiv,2)[1]
#         ptTree.Add(tempPt,Path(i))
#         ptListTemp.append(tempPt)
#     ptList.append(ptListTemp)
# 
# for i in range(uDiv):
#     for j in range(vDiv):
# 
#         pt1 = ptList[i][j]
#         pt2 = ptList[i+1][j]
#         pt3 = ptList[i][j+1]
#         pt4 = ptList[i+1][j+1]
# 
#         pl.append(rg.Polyline([pt1,pt2,pt4,pt3,pt1]))
# 
# a = ptList
# EJERCICIO_003: En este ejercicio introduciremos la creación de árboles de datos dentro de nuestros componentes de Python, así como el uso del Type Hint "List" para iterar automáticamente en cada rama de nuestro arbol de datos.
# 
# También utilizaremos condicionales para establecer condiciones simples en nuestro modelo y comprobar condiciones impuestas.
# 
# Ejercicio propuesto: decorar los paneles por grupos.
divide = DivideDomain²(Domain=srf_2, UCount=number_slider, VCount=number_slider_2)
subsrf = Isotrim(Surface=srf_2, Domain=divide)
tolerance = Slider(1.49, range=0.01..2)
debrep = DeconstructBrep(Brep=subsrf)  # -> Faces, Edges, Vertices
# Planarize: import Rhino.Geometry as rg
# import rhinoscriptsyntax as rs
# 
# #Creamos un plano con tres puntos cualesquiera
# plane = rg.Plane(pts[0],pts[1],pts[2])
# 
# #Proyectamos el punto 3 sobre el plano calculado
# newPt3 = plane.ClosestPoint(pts[3])
# 
# #Calculamos el desplazamiento de cada punto
# dev = pts[3].DistanceTo(newPt3)
# 
# #Sustituimos el punto 3 por su nuevo valor
# pts[3] = newPt3
# lines = []
# 
# #Creamos una marca en cada panel fuera de tolerancia
# if dev>T:
# 
#     l0 = rg.Line(pts[0],pts[2])
#     l1 = rg.Line(pts[1],pts[3])
#     lines.extend([l0,l1])
# 
# #Creamos la polilinea de cada panel y calculamos su area
# pol = rg.PolylineCurve((pts[0],pts[1],pts[2],pts[3],pts[0]))
# 
# areaObj = rg.AreaMassProperties.Compute(pol)
# area = areaObj.Area
# 
# a = pts
# w = lines
planarize = PythonScript(pts=simplify(debrep.Vertices), T=simplify(tolerance))  # -> out, simplify(a), dev, simplify(w), pol, area; inputs pts: list of Point3d
# ---------- planarize: Python ----------
import Rhino.Geometry as rg
import rhinoscriptsyntax as rs

#Creamos un plano con tres puntos cualesquiera
plane = rg.Plane(pts[0],pts[1],pts[2])

#Proyectamos el punto 3 sobre el plano calculado
newPt3 = plane.ClosestPoint(pts[3])

#Calculamos el desplazamiento de cada punto
dev = pts[3].DistanceTo(newPt3)

#Sustituimos el punto 3 por su nuevo valor
pts[3] = newPt3
lines = []

#Creamos una marca en cada panel fuera de tolerancia
if dev>T:
    
    l0 = rg.Line(pts[0],pts[2])
    l1 = rg.Line(pts[1],pts[3])
    lines.extend([l0,l1])

#Creamos la polilinea de cada panel y calculamos su area    
pol = rg.PolylineCurve((pts[0],pts[1],pts[2],pts[3],pts[0]))

areaObj = rg.AreaMassProperties.Compute(pol)
area = areaObj.Area

a = pts
w = lines
# ---------- end planarize ----------
