# Grasshopper definition Peter random walk final.gh (Grasshopper 0.9.76)
# plug-ins: Python Interpreter

boolean_toggle = BooleanToggle(False)  # "2D/3D"; disabled
panel = Panel("""2D=TRUE
3D=FALSE""")  # disabled

number_slider = Slider(44, range=0..100)  # disabled
number_slider_2 = Slider(78, range=0..100)  # disabled
pt = Point(Point(-1.047090575, -2.275346063, 0))  # disabled
python = PythonScript(pt0=pt, It=number_slider_2, s=number_slider, dim=boolean_toggle)  # -> out, ptList, lines; inputs It: Int32; disabled
# ---------- python: Python ----------
import rhinoscriptsyntax as rs
#Importamos random 
import random as rn

#tipos de paso
steps = [-1,0,1]

#Lista de puntos [incluyendo punto inicial] y lineas
pts = [pt0]
lines = []

#Seeds y listas vacias para los valores x,y,z
rn.seed(s)
xlist = []
ylist = []
zlist = []

#Descomponemos el punto inicial en x,y,z
pt = rs.PointCoordinates(pt0)
ptx = pt[0]
pty = pt[1]
ptz = pt[2]

#comenzamos a calcular los pasos en cada dimension
for i in range(It):
    #Pasos en cada dirección 
    x = rn.choice(steps)
    y = rn.choice(steps)
    #CONTROL DIMENSIONAL
    if dim==0:
         z = rn.choice(steps)
    else:
        z=0
    #FIN DEL CONTROL DIMENSIONAL-->creemos listas!
   
    xlist.append(x)
    ylist.append(y)
    zlist.append(z)
    
    #Sumatorios de pasos y construcción de los puntos (punto inicial más el sumatorio de pasos)
    
    pt = rs.AddPoint((ptx+sum(xlist)),(pty+sum(ylist)),(ptz+sum(zlist)))
    #Todos los puntos a una lista y hacemos polyline
    pts.append(pt)
ptList = pts
lines = rs.AddPolyline(ptList)
# ---------- end python ----------
crv = Curve(python.lines)  # disabled
pt_2 = Point(python.ptList)  # disabled

boolean_toggle_2 = BooleanToggle(False)  # "2D/3D"
panel_2 = Panel("""2D=TRUE
3D=FALSE""")
boolean_toggle_3 = BooleanToggle(False)  # "2D/3D"
pt_3 = Point(Point(-1.047090575, -2.275346063, 0))
pt_4 = Point(Point(-1.047090575, -2.275346063, 0))
python_2 = PythonScript(
    pt0=pt_3,
    Amin=Slider(25, range=0..360),
    AMAX=Slider(120, range=0..360),
    Rmin=Slider(2, range=0..5),
    RMAX=Slider(5, range=0..5),
    It=Slider(48, range=0..100),
    s=Slider(28, range=0..100),
    dim=boolean_toggle_2)  # -> out, ptList, lines, new, triangles; inputs Amin: Int32, AMAX: Int32, Rmin: Int32, RMAX: Int32, It: Int32
# ---------- python_2: Python ----------
import rhinoscriptsyntax as rs
#Importamos random 
import random as rn
#Creamos seed y listas para los puntos, lineas y triangulos
rn.seed(s)
pts = [pt0]
lines = []
triangles = []
newptList = [pt0]
#Iteramos para la creacion de cada punto linea y triangulo
for i in range(It):
    #los puntos en polares con angulos y pasos controladp
    angulos = rn.randint(Amin,AMAX)
    steps = rn.randint(Rmin,RMAX)
    NewPts = rs.Polar((pts[-1]),angulos,steps)
    pts.append(NewPts)
    
    #Una vez creado los puntos creamos los triangulos,
    #Primero la linea y el punto medio
    a = pts[i] 
    b = pts[i+1]
    line = rs.AddLine(a,b)
    lines.append(line)
    mid = rs.CurveMidPoint(line)
    
    #Sacamos el vector normal a la recta y lo escalamos por un random
    rnleng = ((rn.randint(3,10))/10)
    z = rs.CurveNormal(line)
    vector = rs.VectorCreate(a,b)
    nor = rs.VectorCrossProduct(vector,z)
    normal = rs.VectorScale(nor,rnleng)
    trans1 = rs.XformTranslation(normal)
    trans2 = rs.XformTranslation(rs.VectorReverse(normal))
    
    
    #Desplazamos los puntos medios el vector normal escalado
    newpts1 = rs.PointTransform(mid,trans1)
    newpts2 = rs.PointTransform(mid,trans2)
    
    #Creamos el triangulo con polyline
    if rs.Distance(newpts1,newptList[-1])>rs.Distance(newpts2,newptList[-1]):
        newpts = newpts1
    else:
        newpts = newpts2
    
    tri = rs.AddPolyline([a,b,newpts,a])
    triangles.append(tri)
    
ptList = pts
# ---------- end python_2 ----------
python_3 = PythonScript(
    pt0=pt_4,
    Amin=Slider(25, range=0..360),
    AMAX=Slider(114, range=0..360),
    Rmin=Slider(3, range=0..5),
    RMAX=Slider(5, range=0..5),
    It=Slider(15, range=0..100),
    s=Slider(20, range=0..100),
    dim=boolean_toggle_3)  # -> out, ptList, new, triangles; inputs Amin: Int32, AMAX: Int32, Rmin: Int32, RMAX: Int32, It: Int32
# ---------- python_3: Python ----------
import rhinoscriptsyntax as rs
#Importamos random 
import random as rn
#Creamos seed y listas para los puntos, lineas y triangulos
rn.seed(s)
pts = [pt0]
lines = []
triangles = []
newptList = [pt0]
#Iteramos para la creacion de cada punto linea y triangulo
for i in range(It):
    #los puntos en polares con angulos y pasos controladp
    angulos = rn.randint(Amin,AMAX)
    steps = rn.randint(Rmin,RMAX)
    NewPts = rs.Polar((pts[-1]),angulos,steps)
    pts.append(NewPts)
    
    #Una vez creado los puntos creamos los triangulos,
    #Primero la linea y el punto medio
    a = pts[i] 
    b = pts[i+1]
    line = rs.AddLine(a,b)
    lines.append(line)
    
    #Sacamos el vector normal a la recta y lo escalamos por un random
    rnleng = ((rn.randint(3,5))/10)
    z = rs.CurveNormal(line)
    vector = rs.VectorCreate(a,b)
    nor = rs.VectorCrossProduct(vector,z)
    normal = rs.VectorScale(nor,rnleng)
    trans1 = rs.XformTranslation(normal)
    trans2 = rs.XformTranslation(rs.VectorReverse(normal))
    
    
    #Desplazamos los puntos medios el vector normal escalado
    newpts1 = rs.PointTransform(a,trans1)
    newpts2 = rs.PointTransform(a,trans2)
    

    
    tri = rs.AddPolyline([b,newpts1,newpts2,b])
    triangles.append(tri)
    
ptList = pts
# ---------- end python_3 ----------
crv_2 = Curve(python_2.triangles)
pt_5 = Point([python_2.ptList, python_2.new])
line = Line(python_2.lines)
crv_3 = Curve(python_3.triangles)
pt_6 = Point([python_3.ptList, python_3.new])
