# Grasshopper definition CRJ_EJ_003_FilterDataTree.gh (Grasshopper 0.9.76)
# Copyright: Ángel Linares García 2014
# plug-ins: Python Interpreter

# ^ = Reparameterize:
# Los valores los reparametriza de 0 a 1
srf = Surface(reparameterize(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))
number_slider = Slider(9, range=1..25)
number_slider_2 = Slider(14, range=1..25)
# TAREAS:
# Acabar el Random Walker Modified
# Modificar el Filter DataTree: que los paneles no estén alabeados:
# Triangular la superficie tomando puntos de 3 en 3.
# Cuadrangular. Los cuadrados estan alabeados: hacer que estén planos: tomamos 3ptos del cuadrado que forman un plano, forzamos que el cuarto esté en la superficie
divsrf = PythonScript(srf=srf, uDiv=number_slider, vDiv=number_slider_2)  # -> out, ptList, panel; inputs srf: Surface, uDiv: Int32, vDiv: Int32
# ---------- divsrf: Python ----------
#CRJ_EJ003_Filter DataTree

#librerias
import Rhino.Geometry as rg

#lista
ptList = []
polList = []

#bucle doble para generar los puntos. Toma el primer elemento del primer bucle y lo combina con todos los del segundo
for i in range (uDiv+1):
    ptListTemp = []

    for j in range (vDiv+1):
        ptTemp = srf.Evaluate(i/uDiv,j/vDiv,2) [1]
        ptListTemp.append (ptTemp)
        
#lista que contiene sublistas de puntos (columnas de la matriz)
    ptList.append(ptListTemp)
    #para acceder a valores de una lista dentro de otra lista
    #tomar la primera sublista
    #ptList [0]
    #tomar el segundo valor de la primera sublista
    #ptList [0][1]
    


#nuevo bucle doble para generar los paneles.
#separar todos los primeros puntos de los paneles en una lista, todos los segundos en otra...hacer 4 listas
for i in range (uDiv):
    for j in range (vDiv):
        pt0 = ptList [i][j]
        pt1 = ptList [i+1][j]
        pt2 = ptList [i][j+1]
        pt3 = ptList [i+1][j+1]
        
        #Unimos los puntos con una polilinea
        polList.append(rg.Polyline([pt0,pt1,pt3,pt2,pt0]))
        
panel = polList
# ---------- end divsrf ----------
dividesrf = PythonScript(srf=srf, uDiv=number_slider, vDiv=number_slider_2)  # -> out, a; inputs srf: Surface, uDiv: Int32, vDiv: Int32
# ---------- dividesrf: Python ----------
import Rhino.Geometry as rg
from Grasshopper import DataTree as Tree
from Grasshopper.Kernel.Data import GH_Path as Path

ptList = []
ptTree = Tree[object]()

for i in range(uDiv+1):
    for j in range(vDiv+1):
        
        tempPt = srf.Evaluate(i/uDiv,j/vDiv,2)[1]
        ptTree.Add(tempPt,Path(i))
        
a = ptTree
# ---------- end dividesrf ----------
# CODE Divide Srf: import Rhino.Geometry as rg
# from Grasshopper import DataTree as Tree
# from Grasshopper.Kernel.Data import GH_Path as Path
# 
# ptList = []
# ptTree = Tree[object]()
# 
# for i in range(uDiv+1):
#     for j in range(vDiv+1):
# 
#         tempPt = srf.Evaluate(i/uDiv,j/vDiv,2)[1]
#         ptTree.Add(tempPt,Path(i))
# 
# a = ptTree
# EJERCICIO_003: En este ejercicio introduciremos la creación de árboles de datos dentro de nuestros componentes de Python, así como el uso del Type Hint "List" para iterar automáticamente en cada rama de nuestro arbol de datos.
# 
# También utilizaremos condicionales para establecer condiciones simples en nuestro modelo y comprobar condiciones impuestas.
# 
# Ejercicio propuesto: decorar los paneles por grupos.
# 1.Crea puntos sobre la superfice
# 2. Los toma de 4 en 4, con 3 de ellos forma un plano, el cuarto está desplazado, y crea el alabeo
# 3. Si ese cuarto punto está a una distancia mayor a la impuesta, te tacha el recuadro para avisarte
divide = DivideDomain²(Domain=srf, UCount=number_slider, VCount=number_slider_2)
subsrf = Isotrim(Surface=srf, Domain=divide)
tolerance = Slider(0.2, range=0.01..2)
debrep = DeconstructBrep(Brep=subsrf)  # -> Faces, Edges, Vertices
# Planarize: import Rhino.Geometry as rg
# import rhinoscriptsyntax as rs
# 
# #Creamos un plano con tres puntos cualesquiera
# plane = rg.Plane(pts[0],pts[1],pts[2])
# 
# #Proyectamos el punto 3 sobre el plano calculado
# newPt3 = plane.ClosestPoint(pts[3])
# 
# #Calculamos el desplazamiento de cada punto
# dev = pts[3].DistanceTo(newPt3)
# 
# #Sustituimos el punto 3 por su nuevo valor
# pts[3] = newPt3
# lines = []
# 
# #Creamos una marca en cada panel fuera de tolerancia
# if dev>T:
# 
#     l0 = rg.Line(pts[0],pts[2])
#     l1 = rg.Line(pts[1],pts[3])
#     lines.extend([l0,l1])
# 
# #Creamos la polilinea de cada panel y calculamos su area
# pol = rg.PolylineCurve((pts[0],pts[1],pts[2],pts[3],pts[0]))
# 
# areaObj = rg.AreaMassProperties.Compute(pol)
# area = areaObj.Area
# 
# a = pts
# w = lines
planarize = PythonScript(pts=simplify(debrep.Vertices), T=simplify(tolerance))  # -> out, simplify(a), dev, simplify(w), pol, area; inputs pts: list of Point3d
# ---------- planarize: Python ----------
import Rhino.Geometry as rg
import rhinoscriptsyntax as rs

#Creamos un plano con tres puntos cualesquiera
plane = rg.Plane(pts[0],pts[1],pts[2])

#Proyectamos el punto 3 sobre el plano calculado
newPt3 = plane.ClosestPoint(pts[3])

#Calculamos el desplazamiento de cada punto
dev = pts[3].DistanceTo(newPt3)

#Sustituimos el punto 3 por su nuevo valor
pts[3] = newPt3
lines = []

#Creamos una marca en cada panel fuera de tolerancia
if dev>T:
    
    l0 = rg.Line(pts[0],pts[2])
    l1 = rg.Line(pts[1],pts[3])
    lines.extend([l0,l1])

#Creamos la polilinea de cada panel y calculamos su area    
pol = rg.PolylineCurve((pts[0],pts[1],pts[2],pts[3],pts[0]))

areaObj = rg.AreaMassProperties.Compute(pol)
area = areaObj.Area

a = pts
w = lines
# ---------- end planarize ----------
