# Grasshopper definition Ej_003c_colours.gh (Grasshopper 0.9.76)
# plug-ins: Python Interpreter

file = ReadFile(File="C:\201407_data\2014_fablab\ghPython101\Día_003\01_EJ\colours.py", PerLineParse=False)
colours = PythonScript(Code=file, Me=Slider(0, range=0..5), Dev=Slider(1.1, range=0..5), S=Slider(204, range=1..500))  # -> A, ColList
preview = CustomPreview(Geometry=colours.A, Shader=colours.ColList)
