# Grasshopper definition Ej_003d_RW_poly.gh (Grasshopper 0.9.76)
# Copyright: Ángel Linares García 2014
# plug-ins: Python Interpreter

pt = Point(<point referenced from the Rhino model>)
# EJERCICIO_004a: En este ejercicio se aborda la creción de una función para crear polígonos sobre un punto cualquiera y con un número de lados determinado.
# 
# Esta función se aplicará para cada punto de nuestro random walker.
# 
# Comentar la línea de creación del BREP y evaluar el tiempo de computación de estas funciones.
# 
# TAREA: adaptar la definición para que funcione con triángulos.
# 
# PREGUNTA: si cambiamos el número de lados, ¿seriamos capaces de adaptar la función para que rellene el plano con cualquier polígono?
file = ReadFile(File="F:\003_CODE\Git\ghPython101\Día_003\01_EJ\RW_polygons.py", PerLineParse=False)
rw_polygon = PythonScript(
    Code=file,
    Pt=pt,
    N=Slider(6, range=1..25),
    R=Slider(1.19, range=0.01..15),
    It=Slider(141, range=1..150),
    S=Slider(395, range=1..900))  # -> Out, Pol, Pts
pline = PolyLine(Vertices=rw_polygon.Pts, Closed=False)
