# Grasshopper definition Ej_004a_KOCH_curve.gh (Grasshopper 0.9.76)
# Copyright: Ángel Linares García 2014
# plug-ins: Python Interpreter

G = Slider(6, range=0..20)
pt = Point(Point(100, 0, 0))
pt_2 = Point(Point(0, 0, 0))
# EJERCICIO_005: En este ejercicio aprenderemos la utilidad de las funciones en el empaquetado de código y cómo utilizar estas para generar una nueva estructura para el control de flujo, la recursión. Este tipo de estructuras para el control de flujo son muy útiles para solucionar problemas que pueden resolverse aplicando una función una y otra vez sobre el resultado de ella misma.
# 
# En este caso, pare generar un resultado fácilmente reconocible de este proceso, vamos a generar una de las curvas fractales más sencillas, una curva de KOCH.
file = ReadFile(File="C:\201407_data\2014_fablab\ghPython101\Día_003\01_EJ\Koch_curve.py", PerLineParse=False)
koch_crv = PythonScript(
    PtA=pt_2,
    PtB=pt,
    rat0=Slider(0.5, range=0..1),
    rat1=Slider(0.67, range=0..1),
    rat2=Slider(0.67, range=0..1),
    ratM=Slider(1.68, range=0..2),
    G=G)  # -> out, crv, pts; inputs PtA: Point3d, PtB: Point3d
# ---------- koch_crv: Python ----------
import rhinoscriptsyntax as rs
import math as m

ptList = []

def koch(ptA, ptB, r0, r1, r2, rM):
    
    #points = []
    
    pt0 = ((ptB-ptA)*r0)+ptA
    pt1 = ((ptB-ptA)*r1)+ptA
    
    #Calculating vector perpendicular to ptB-ptA
    cross = rs.VectorCrossProduct((ptB-ptA),(0,0,1))
    cross = rs.VectorUnitize(cross)
    dist = rs.VectorLength((ptB-ptA))
    h = m.sqrt(((dist/3)**2.0)-((dist/6)**2.0))
    pt1 += cross*(h*rM)
    
    pt2 = ((ptB-ptA)*r2)+ptA
    
    #points.extend((pt0,pt1,pt2))
    return [ptA,pt0,pt1,pt2,ptB]
    
def recursive (ptA, ptB, gens, list):
    if gens>0:
        
        newPts = koch (ptA,ptB,rat0,rat1,rat2,ratM)
        curve = rs.AddPolyline(newPts)
        
        if gens == 1:
            list.append(curve)
        
        recursive(newPts[0],newPts[1],gens-1,list)
        recursive(newPts[1],newPts[2],gens-1,list)
        recursive(newPts[2],newPts[3],gens-1,list)
        recursive(newPts[3],newPts[4],gens-1,list)
       
        gens-=1 
        return list
        
crv = recursive(PtA,PtB,G,ptList)
# ---------- end koch_crv ----------
