# Grasshopper definition Ej_004b_recursive_scaling.gh (Grasshopper 0.9.76)
# plug-ins: Python Interpreter

crv = Curve(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)
target = Slider(1193, range=1..1500)
# EJERCICIO_004_a: Es este ejercicio abordaremos la creación de un algoritmo recursivo poco eficiente e intentaremos evidenciar porqué en algunos casos es más sencillo aplicar procesos iterativos en lugar de recursivos en la resolución de problemas.
# 
# Ojo con los valores que asignemos e los sliders, podemos hacer que Rhino se cierre con mucha facilidad.
# 
# Tarea: plantear la resolución del mismo problema desde un proceso iterativo.
file = ReadFile(File="C:\201407_data\2014_fablab\ghPython101\Día_003\01_EJ\Recursive_scaling.py", PerLineParse=False)
rec_scaling = PythonScript(crv=crv, target=target, step=Slider(0.107, range=0.001..1), tolerance=Slider(5, range=5..15))  # -> out, a
# ---------- rec_scaling: Python ----------
import rhinoscriptsyntax as rs
import Rhino.Geometry as rg
import math as m


def scaling(c):
    
    crvArea = rs.CurveArea(c)[0]
    crvCentroid = rs.CurveAreaCentroid(c)[0]
    #print crvCentroid
    
    # Comprobando casos
    if abs(target-crvArea)>tolerance:
        if target > crvArea:
            print "caso_0"
            print "Targe-Area= %f" %abs(target-crvArea)
            print "Tolerance= %f" %tolerance
            print "////////////////////////////////////////////"
        
            crvNew = rs.ScaleObject(c,crvCentroid,[1+step,1+step,0])
            c = scaling(crvNew)
        
        elif target < crvArea:
            print "caso_1"
            print "Targe-Area= %f" %(target-crvArea)
            print "Tolerance= %f" %tolerance
            print "////////////////////////////////////////////"
        
            crvNew = rs.ScaleObject(c,crvCentroid,[1-step,1-step,1-step])
            c = scaling(crvNew)
    
    #print "out"
    return c
        
        
a = scaling(crv)
print a
# ---------- end rec_scaling ----------
area = Area(Geometry=rec_scaling.a)  # -> Area, Centroid
