# Grasshopper definition jpl_ej_003b_filter_datatree_bis_triangles.gh (Grasshopper 0.9.76)
# Copyright: Ángel Linares García 2014
# plug-ins: Python Interpreter

srf = Surface(reparameterize(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))
number_slider = Slider(9, range=1..25)
number_slider_2 = Slider(14, range=1..25)
tolerance = Slider(0.35, range=0.01..2)

# ---- group: gh_way
# CODE Divide Srf: import Rhino.Geometry as rg
# from Grasshopper import DataTree as Tree
# from Grasshopper.Kernel.Data import GH_Path as Path
# 
# ptList = []
# ptTree = Tree[object]()
# pl = []
# 
# for i in range(uDiv+1):
#     ptListTemp = []
#     for j in range(vDiv+1):
# 
#         tempPt = srf.Evaluate(i/uDiv,j/vDiv,2)[1]
#         ptTree.Add(tempPt,Path(i))
#         ptListTemp.append(tempPt)
#     ptList.append(ptListTemp)
# 
# for i in range(uDiv):
#     for j in range(vDiv):
# 
#         pt1 = ptList[i][j]
#         pt2 = ptList[i+1][j]
#         pt3 = ptList[i][j+1]
#         pt4 = ptList[i+1][j+1]
# 
#         pl.append(rg.Polyline([pt1,pt2,pt4,pt3,pt1]))
# 
# a = ptList
# EJERCICIO_003: En este ejercicio introduciremos la creación de árboles de datos dentro de nuestros componentes de Python, así como el uso del Type Hint "List" para iterar automáticamente en cada rama de nuestro arbol de datos.
# 
# También utilizaremos condicionales para establecer condiciones simples en nuestro modelo y comprobar condiciones impuestas.
# 
# Ojo con el bucle "implícito" en el componente de análisis de los paneles.
# 
# Ejercicio propuesto: decorar los paneles por grupos.
divide = DivideDomain²(Domain=srf, UCount=number_slider, VCount=number_slider_2)
subsrf = Isotrim(Surface=srf, Domain=divide)
debrep = DeconstructBrep(Brep=subsrf)  # -> Faces, Edges, simplify(Vertices)

# ---- group: python equivalent
divsrf = PythonScript(srf=srf, uDiv=number_slider, vDiv=number_slider_2)  # -> out, ptTree, panel; inputs srf: Surface, uDiv: Int32, vDiv: Int32
# ---------- divsrf: Python ----------
import Rhino.Geometry as rg
from Grasshopper.Kernel.Data import GH_Path as Path
from Grasshopper import DataTree as Tree 
#las cosas que se estan importando las escribimos con mayusculas
#porque son clases

ptList = []
polList = []

#initializing tree
ptTree = Tree[object]()
polTree = Tree[object]()

for i in range(uDiv+1):
    ptListTemp = []
    
    for j in range(vDiv+1):
        
        ptTemp = srf.Evaluate(i/uDiv,j/vDiv,2)[1]
        ptListTemp.append(ptTemp)
        
    ptList.append(ptListTemp)
    
counter = 0
for i in range(uDiv):
    for j in range(vDiv):
        
        pt0 = ptList[i][j]
        pt1 = ptList[i+1][j]
        pt2 = ptList[i][j+1]
        pt3 = ptList[i+1][j+1]
        
        # Adding points to datatree
        # The commented lines produce the flipped tree.
        #ptTree.Add(pt0,Path(0))
        #ptTree.Add(pt1,Path(1))
        #ptTree.Add(pt2,Path(2))
        #ptTree.Add(pt3,Path(3))
        
        ptTree.AddRange([pt0,pt1,pt3,pt2],Path(counter))
        
        polTree.Add(rg.PolylineCurve([pt0,pt1,pt3,pt2,pt0]),Path(counter))
        counter += 1
        
        #polList.append(rg.Polyline([pt0,pt1,pt3,pt2]))
        
panel = polList
# ---------- end divsrf ----------

# ----
file = ReadFile(File="C:\201407_data\2014_fablab\ghPython101\Día_003\01_EJ\divSrf.py", PerLineParse=False)
panel = Panel(divsrf.ptTree)
planarize = PythonScript(pts=divsrf.ptTree, T=simplify(tolerance))  # -> out, dev, devCol, simplify(w), pol, pol2, pol3, area; inputs pts: list of Point3d
# ---------- planarize: Python ----------
import Rhino.Geometry as rg
import Rhino.Display as rd
import copy_reg as copy


#Creamos un plano con tres puntos cualesquiera
plane = rg.Plane(pts[0],pts[1],pts[2])

#Proyectamos el punto 3 sobre el plano calculado
newPt3 = plane.ClosestPoint(pts[3])

#Calculamos el desplazamiento de cada punto
dev = pts[3].DistanceTo(newPt3)

#Creamos un color HSL(float) con dev y lo transformamos en RGB
devCol = rd.ColorHSL(dev*0.9,1,0.5)
devCol = devCol.ToArgbColor()

#Sustituimos el punto 3 por su nuevo valor
pts.append(newPt3)
lines = [] #estas son las aspas

#Creamos una marca en cada panel fuera de tolerancia
if dev>T:
    
    l0 = rg.Line(pts[0],pts[2])
    l1 = rg.Line(pts[1],pts[4])
    lines.extend([l0,l1])

#Creamos la polilinea de cada panel y calculamos su area    
pol = rg.PolylineCurve((pts[0],pts[1],pts[2],pts[4],pts[0]))
pol2 = rg.PolylineCurve((pts[2],pts[3],pts[4],pts[2]))
pol3 = rg.PolylineCurve((pts[0],pts[3],pts[4],pts[0]))

#areaObj = rg.AreaMassProperties.Compute(pol)
#area = areaObj.Area

w = lines
# ---------- end planarize ----------
file_2 = ReadFile(File="C:\201407_data\2014_fablab\ghPython101\Día_003\01_EJ\Planarize.py", PerLineParse=False)
viewer = ParamViewer(divsrf.ptTree)
# Planarize: import Rhino.Geometry as rg
# import rhinoscriptsyntax as rs
# 
# #Creamos un plano con tres puntos cualesquiera
# plane = rg.Plane(pts[0],pts[1],pts[2])
# 
# #Proyectamos el punto 3 sobre el plano calculado
# newPt3 = plane.ClosestPoint(pts[3])
# 
# #Calculamos el desplazamiento de cada punto
# dev = pts[3].DistanceTo(newPt3)
# 
# #Sustituimos el punto 3 por su nuevo valor
# pts[3] = newPt3
# lines = []
# 
# #Creamos una marca en cada panel fuera de tolerancia
# if dev>T:
# 
#     l0 = rg.Line(pts[0],pts[2])
#     l1 = rg.Line(pts[1],pts[3])
#     lines.extend([l0,l1])
# 
# #Creamos la polilinea de cada panel y calculamos su area
# pol = rg.PolylineCurve((pts[0],pts[1],pts[2],pts[3],pts[0]))
# 
# areaObj = rg.AreaMassProperties.Compute(pol)
# area = areaObj.Area
# 
# a = pts
# w = lines
viewer_2 = ParamViewer(debrep.Vertices)
boundary = BoundarySurfaces(Edges=[planarize.pol, planarize.pol2, planarize.pol3])
panel_2 = Panel(planarize.devCol)
panel_3 = Panel(planarize.w)
panel_4 = Panel(planarize.pol)
panel_5 = Panel(planarize.area)
preview = CustomPreview(Geometry=[planarize.pol, planarize.pol2], Shader=planarize.devCol)
preview_2 = CustomPreview(Geometry=boundary, Shader=planarize.devCol)
