# Grasshopper definition prueba_funcion.gh (Grasshopper 0.9.76)
# plug-ins: Python Interpreter

python = PythonScript()  # -> out, x
# ---------- python: Python ----------
def pruebaFuncion(a,b):
    c = a+b
    return c

x = pruebaFuncion(2,3)
print x
# ---------- end python ----------
panel = Panel(python.x)
