# Grasshopper definition Ej_006_finding_tangent.gh (Grasshopper 0.9.76)
# plug-ins: Python Interpreter

file = ReadFile(File="F:\003_CODE\Git\ghPython101\Día_004\01_EJ\crv_tangent.py", PerLineParse=False)
pt = Point(<point referenced from the Rhino model>)
crv = Curve(<curve referenced from the Rhino model>)
python = PythonScript(Code=file, P=pt, Crv=crv, N=Slider(219, range=1..500))  # -> Out, A, B
panel = Panel(python.Out)
crv_2 = Curve(python.B)
pt_2 = Point(python.A)
item = ListItem(List=crv_2, Index=Slider(0, range=0..2), Wrap=True)
