# Grasshopper definition Ej_006_recursive_chord.gh (Grasshopper 0.9.76)
# plug-ins: Python Interpreter

file = ReadFile(File="F:\003_CODE\Git\ghPython101\Día_004\01_EJ\crv_chords.py", PerLineParse=False)
pt = Point(<point referenced from the Rhino model>)
crv = Curve(<curve referenced from the Rhino model>)
python = PythonScript(Code=file, P=pt, Crv=crv, N=Slider(385, range=1..500))  # -> Out, A, B
panel = Panel(python.Out)
