# Grasshopper definition Ej_006_recursive_div.gh (Grasshopper 0.9.76)
# Copyright: Ángel Linares García 2014
# plug-ins: Python Interpreter

number_slider = Slider(14, range=1..25)
number_slider_2 = Slider(19, range=1..25)
tolerance = Slider(0.29, range=0.01..2)
srf = Surface(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)

# ---- group: gh_way
# CODE Divide Srf: import Rhino.Geometry as rg
# from Grasshopper import DataTree as Tree
# from Grasshopper.Kernel.Data import GH_Path as Path
# 
# ptList = []
# ptTree = Tree[object]()
# pl = []
# 
# for i in range(uDiv+1):
#     ptListTemp = []
#     for j in range(vDiv+1):
# 
#         tempPt = srf.Evaluate(i/uDiv,j/vDiv,2)[1]
#         ptTree.Add(tempPt,Path(i))
#         ptListTemp.append(tempPt)
#     ptList.append(ptListTemp)
# 
# for i in range(uDiv):
#     for j in range(vDiv):
# 
#         pt1 = ptList[i][j]
#         pt2 = ptList[i+1][j]
#         pt3 = ptList[i][j+1]
#         pt4 = ptList[i+1][j+1]
# 
#         pl.append(rg.Polyline([pt1,pt2,pt4,pt3,pt1]))
# 
# a = ptList
# EJERCICIO_003: En este ejercicio introduciremos la creación de árboles de datos dentro de nuestros componentes de Python, así como el uso del Type Hint "List" para iterar automáticamente en cada rama de nuestro arbol de datos.
# 
# También utilizaremos condicionales para establecer condiciones simples en nuestro modelo y comprobar condiciones impuestas.
# 
# Ojo con el bucle "implícito" en el componente de análisis de los paneles.
# 
# Ejercicio propuesto: decorar los paneles por grupos.
divide = DivideDomain²(Domain=srf, UCount=number_slider, VCount=number_slider_2)
subsrf = Isotrim(Surface=srf, Domain=divide)
debrep = DeconstructBrep(Brep=subsrf)  # -> Faces, Edges, simplify(Vertices)

# ----
file = ReadFile(File="F:\003_CODE\Git\ghPython101\Día_004\01_EJ\divSrf_rec.py", PerLineParse=False)

# ---- group: python equivalent
divsrf = PythonScript(Code=file, Srf=srf, UDiv=number_slider, VDiv=number_slider_2, X=tolerance)  # -> Out, PtTree, Panel

# ----
domain_test = PythonScript(x=srf)  # -> out, a; inputs x: Surface
# ---------- domain_test: Python ----------
a = x.Domain(1)[1]
print a
# ---------- end domain_test ----------
viewer = ParamViewer(divsrf.PtTree)
panel = Panel(divsrf.Out)
# Planarize: import Rhino.Geometry as rg
# import rhinoscriptsyntax as rs
# 
# #Creamos un plano con tres puntos cualesquiera
# plane = rg.Plane(pts[0],pts[1],pts[2])
# 
# #Proyectamos el punto 3 sobre el plano calculado
# newPt3 = plane.ClosestPoint(pts[3])
# 
# #Calculamos el desplazamiento de cada punto
# dev = pts[3].DistanceTo(newPt3)
# 
# #Sustituimos el punto 3 por su nuevo valor
# pts[3] = newPt3
# lines = []
# 
# #Creamos una marca en cada panel fuera de tolerancia
# if dev>T:
# 
#     l0 = rg.Line(pts[0],pts[2])
#     l1 = rg.Line(pts[1],pts[3])
#     lines.extend([l0,l1])
# 
# #Creamos la polilinea de cada panel y calculamos su area
# pol = rg.PolylineCurve((pts[0],pts[1],pts[2],pts[3],pts[0]))
# 
# areaObj = rg.AreaMassProperties.Compute(pol)
# area = areaObj.Area
# 
# a = pts
# w = lines
viewer_2 = ParamViewer(debrep.Vertices)
