# Grasshopper definition Polyhedra.gh (Grasshopper 0.9.76)
# plug-ins: Python Interpreter

poly = Slider(5, range=0..10)
brep = Brep([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])
item = ListItem(List=brep, Index=poly, Wrap=True)
smesh = SimpleMesh(Brep=item)
mjoin = MeshJoin(Meshes=smesh)
file = ReadFile(File="F:\003_CODE\Git\ghPython101\Día_004\01_EJ\Polyhedra_Subd.py", PerLineParse=False)
python = PythonScript(Code=file, X=mjoin)  # -> Out, A
demesh = DeconstructMesh(Mesh=smesh)  # -> Vertices, Faces, Colours, Normals
panel = Panel(python.Out)
