# Grasshopper definition Polyhedra_2.gh (Grasshopper 1.0.8)

brep = Brep([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])
number_slider = Slider(128, range=0..256)
number_slider_2 = Slider(86, range=0..256)
poly = Slider(6, range=0..10)
volume = Volume(Geometry=brep)  # -> Volume, Centroid
pt = Point(Point(0, 0, 0))
file = ReadFile(File="C:\ZZ_Code\ZZ_Personal\ghPython101\Día_004\01_EJ\Polyhedra_Subd_rec_3.py", PerLineParse=False)
dom = ConstructDomain(DomainStart=expr("-x", number_slider), DomainEnd=number_slider)
dom_2 = ConstructDomain(DomainStart=expr("-x", number_slider_2), DomainEnd=number_slider_2)
item = ListItem(List=brep, Index=poly, Wrap=True)
range = Range(Domain=dom_2, Steps=expr("x-1", Slider(3, range=0..5)))
range_2 = Range(Domain=dom_2, Steps=expr("x-1", Slider(4, range=0..5)))
rectangle = Rectangle(Plane=PlaneXY(0, 0, 0), XSize=dom, YSize=dom, Radius=0)  # -> Rectangle, Length
crossref = CrossReference(ListA=range, ListB=range_2, CrossMode=1)  # -> ListA, ListB
pt_2 = ConstructPoint(XCoordinate=crossref.ListA, YCoordinate=crossref.ListB, ZCoordinate=0)
short = ShortestList(ListA=volume.Centroid, ListB=pt_2, TrimMode=2)  # -> ListA, ListB
vec2pt = Vector2Pt(PointA=short.ListA, PointB=short.ListB, Unitize=False)  # -> Vector, Length
move = Move(Geometry=brep, Motion=vec2pt.Vector)  # -> Geometry, Transform
scale = Scale(Geometry=move.Geometry, Center=short.ListB, Factor=Slider(3.3, range=0..5))  # -> Geometry, Transform
python = PythonScript(Code=file, Brep=scale.Geometry, Dist=Slider(9.053, range=0..15), Gen=Slider(7, range=1..10))  # -> Out, A
mesh = Mesh(python.A)
panel = Panel(python.Out)
