# Grasshopper definition jpl_panelado_superficie_con_funcion_panel.gh (Grasshopper 0.9.76)
# plug-ins: Python Interpreter

num_divisiones_u = Slider(5, range=0..24)
num_divisiones_v = Slider(6, range=0..24)
# Reparamtetriza la superficie u, v va de cero a 1
srf = Surface(reparameterize(<surface referenced from the Rhino model>))
python = PythonScript(srf=srf, uDiv=num_divisiones_u, vDiv=num_divisiones_v)  # -> out, ptList, panels; inputs srf: Surface, uDiv: Int32, vDiv: Int32
# ---------- python: Python ----------
import Rhino.Geometry as rg

def panelGen(pt0,pt1,pt2,pt3):
    pan = rg.PolylineCurve([pt0,pt1,pt2,pt3,pt0])

    return pan
    
#print panel

ptList = []
polList = []

for i in range(uDiv+1):
    ptListTemp = []
    for j in range(vDiv+1):
        
        #print "puntos " + str(i) + "." + str(j)
        #atencion superficie reparametrizada en gh
        ptTemp = srf.Evaluate(i/uDiv,j/vDiv,2)[1]
        ptListTemp.append(ptTemp)
        
    ptList.append(ptListTemp)
    #print ptList

for i in range(uDiv):
    for j in range(vDiv):
        
        pt0a = ptList[i][j]
        pt1a = ptList[i+1][j]
        pt2a = ptList[i+1][j+1]
        pt3a = ptList[i][j+1]
        
        panel = panelGen(pt0a,pt1a,pt2a,pt3a)
        
        polList.append(panel)
        
panels = polList
# ---------- end python ----------
panel = Panel(python.panels)
item = ListItem(List=python.panels, Index=Slider(57, range=0..240), Wrap=True)
fpatch = FragmentPatch(Boundary=item)
