# Grasshopper definition RNR_ejercicio01_sin_cambios.gh (Grasshopper 0.9.75)
# plug-ins: Python Interpreter

pt = Point(Point(0, 0, 0))
python = PythonScript(ptB=pt, C=Slider(2.48, range=0.01..15), alpha=Slider(137.508, range=0..300), it=Slider(73, range=0..200))  # -> out, auxPt; inputs it: Int32
# ---------- python: Python ----------
import rhinoscriptsyntax as rs
import math as m

auxPt = []
for i in range(it):
    angTheta = alpha*i
    radius = C*m.sqrt(angTheta)
    pt = rs.Polar(ptB,angTheta,radius)
    auxPt.append(pt)
# ---------- end python ----------
voronoi = Voronoi(Points=python.auxPt, BruteForceOverride=False)
